# Grasshopper definition GH01_GeomConversionTesting.gh (Grasshopper 1.0.6)
# plug-ins: UserDataUtils

# ---- group: Select something in rhino and click this dude
rsel = RhSelection(x=Toggle(True))  # -> out, A
# ---------- rsel: C# usings ----------
using System.IO;
using System.Linq;
using System.Data;
using System.Drawing;
using System.Reflection;
using System.Windows.Forms;
using System.Xml;
using System.Xml.Linq;
using System.Runtime.InteropServices;

using Rhino.DocObjects;
using Rhino.Collections;
using GH_IO;
using GH_IO.Serialization;
# ---------- rsel: C# ----------
    A = RhinoDoc.ActiveDoc.Objects.GetSelectedObjects(true, true).Select(xxx => xxx.Geometry);
# ---------- end rsel ----------

# ----
srl = Serialiser(Object=rsel.A)  # -> ConversionResultString, ConversionResult
dsr = Deserialiser(Object=srl.ConversionResult)
srl_2 = Serialiser(Object=dsr)  # -> ConversionResultString, ConversionResult
c_script = CSharpScript(x=srl_2.ConversionResult, y=srl.ConversionResult)  # -> out, A, B
# ---------- c_script: C# ----------
    var hash1 = x.GetType().GetProperty("Hash").GetValue(x, null) as string;
    var hash2 = y.GetType().GetProperty("Hash").GetValue(y, null) as string;

    A = hash1 == hash2;
    B = hash1 + " vs " + hash2;
# ---------- end c_script ----------
geo = Geometry(dsr)

# ---- group: Theoretically, hashes should be the same after a serialisation run
are_the_hashes_equal = Panel(c_script.A)
panel = Panel(c_script.B)
